# Requirement set APCS_REQ (R2023a)

## 1 [APCS-REQ!Blad1] References to APCS-REQ.xlsx (Blad1) (Container)
Read-only references to Microsoft Excel document.

### 1.1 [APCS-REQ-001] The system shall be able to determine its own attitude

### 1.2 [APCS-REQ-002] The system shall be able to change its orbit

### 1.3 [APCS-REQ-003] The system shall be able to de-orbit at the end of its mission lifetime

### 1.4 [APCS-REQ-004] The system shall be able to de-tumble after launch

### 1.5 [APCS-REQ-005] The system shall be able to control its attitude

### 1.6 [APCS-REQ-006] When the system is inside the launcher, the system shall be disabled according to launch specifications

### 1.7 [APCS-REQ-007] The CubeSat shall be able to update the software of its sub-systems

### 1.8 [APCS-REQ-008] The CubeSat shall be able to check that a software update was installed and works as expected

### 1.9 [APCS-REQ-009] The CubeSat shall be able to monitor system's health status

### 1.10 [APCS-REQ-010] When the CubeSat receives a command from the ground station, the CubeSat shall be able to determine if the command is safe to execute

### 1.11 [APCS-REQ-011] When the CubeSat receives a command from the ground station, the CubeSat shall be able to execute the command

### 1.12 [APCS-REQ-012] If the CubeSat is able to perform the recieved command, then the CubeSat shall notify the sender of the command that it succeeded to perform the command

### 1.13 [APCS-REQ-013] The CubeSat shall be able to prevent the execution of a non-safe command recieved from the ground station

### 1.14 [APCS-REQ-014] The CubeSat shall be able to control its thrust

### 1.15 [APCS-REQ-015] The CubeSat shall be able to detect anomalies in thrust and attitude control while changing attitude

### 1.16 [APCS-REQ-016] If changing orbit and an anomaly is detected, THEN the system shall notify the user

### 1.17 [APCS-REQ-017] The CubeSat shall be able to determine its attitude

### 1.18 [APCS-REQ-018] The CubeSat shall recognise the command to change orbit

### 1.19 [APCS-REQ-019] The CubeSat shall recognise the command to de-orbit

### 1.20 [APCS-REQ-020] The CubeSat shall recognise the command to change attitude

### 1.21 [APCS-REQ-021] The CubeSat shall be made of materials that can burn up when reentering the atmosphere

### 1.22 [APCS-REQ-022] The CubeSat shall be able to counteract and neutralise the change in attitude induced by being launched

### 1.23 [APCS-REQ-023] If changing the attitude and an anomaly is detected, THEN the CubeSat shall notify the user

### 1.24 [APCS-REQ-024] The CubeSat shall be able to notify the user of the completion of its attitude change

### 1.25 [APCS-REQ-025] If the CubeSat is not able to perform the recieved command, then the CubeSat shall notify the sender of the command that it failed to perform the command