# Requirement set APCS_REQS1_1 (R2023a)

## 1 [APCS_REQS1.1!Sheet2] References to APCS_REQS1.1.xlsx (Sheet2) (Container)
Read-only references to Microsoft Excel document.

### 1.1 [APCS-REQ-001] The APCS shall be able to collect sensor data

### 1.2 [APCS-REQ-002] The APCS shall be able to convert sensor data to attitude values

### 1.3 [APCS-REQ-003] The APCS shall be able to communicate with the CDHS

### 1.4 [APCS-REQ-004] The APCS shall be able to receive thrust command

### 1.5 [APCS-REQ-005] The APCS shall be able to receive attitude command

### 1.6 [APCS-REQ-006] The APCS shall reach the desired attitude within {x time units}

### 1.7 [APCS-REQ-007] The APCS shall be able to compare the desired attitude to its actual attitude

### 1.8 [APCS-REQ-008] The APCS shall reach the desired position within {x time units}

### 1.9 [APCS-REQ-009] The APCS shall be able to detect anomalies in thrust control

### 1.10 [APCS-REQ-010] If anomalies in thrust control are detected, the APCS shall inform the user

### 1.11 [APCS-REQ-011] The APCS shall be able to detect anomalies in attitude control

### 1.12 [APCS-REQ-012] If anomalies in attitude control are detected, the APCS shall inform the user

### 1.13 [APCS-REQ-014] The APCS shall be able to sense the completion of commands

### 1.14 [APCS-REQ-015] The APCS shall inform the user of the completion of commands

### 1.15 [APCS-REQ-016] The APCS shall be able to receive health check request

### 1.16 [APCS-REQ-017] The APCS shall be able to distribute health check request to its sub-system

### 1.17 [APCS-REQ-018] The APCS shall be able to conduct individual sub-systems health check

### 1.18 [APCS-REQ-019] The APCS shall be able to detect when the systems health is non-acceptable

### 1.19 [APCS-REQ-020] The APCS shall be able to collect the health results from all sub-systems within the APCS

### 1.20 [APCS-REQ-021] The APCS shall be able to receive software updates

### 1.21 [APCS-REQ-022] The APCS shall be able to recognize which functions shall be updated

### 1.22 [APCS-REQ-023] While the APCS updates its software, the APCS shall keep execution of affected functionalities paused

### 1.23 [APCS-REQ-024] When the APCS has finished its software update the APCS shall continue execution of affected functionalities

### 1.24 [APCS-REQ-025] The APCS shall be able to update software within {x time units} after receiving the software update

### 1.25 [APCS-REQ-026] The APCS shall be able to check if software is correctly updated

### 1.26 [APCS-REQ-028] If the software is not updated correctly, the APCS shall inform the user

### 1.27 [APCS-REQ-029] If the software is not updated correctly, the APCS shall disregard the software update and resume to the previous version

### 1.28 [APCS-REQ-030] When the APCS software update is accepted, then the APCS shall resume the paused functionalities

### 1.29 [APCS-REQ-031] The APCS shall be able to be enabled

### 1.30 [APCS-REQ-032] The APCS shall be able to be disabled

### 1.31 [APCS-REQ-033] The APCS shall control if the command is within reasonable value

### 1.32 [APCS-REQ-034] If the command is outside reasonable values, the APCS shall inform the user

### 1.33 [APCS-REQ-035] The APCS shall be made of material that shall burn up when reentering the atmosphere

### 1.34 [APCS-REQ-036] The total mass of the APCS shall not exceed 4 kg

### 1.35 [APCS-REQ-037] The dimensions of the APCS shall be 100x100x200 mm

### 1.36 [APCS-REQ-038] If the command is outside reasonable values, then APCS shall not execute the command

### 1.37 [APCS-REQ-039] The APCS shall be able to execute commands received from ground station

### 1.38 [APCS-REQ-040] The APCS shall be able to activate its propulsion

### 1.39 [APCS-REQ-041] The APCS shall be able to classify the received information

### 1.40 [APCS-DEP-REQ-001] When receiving a command to dissable the SanityCheck the APCS shall bypass all sanity checks for commands

### 1.41 [APCS-DEP-REQ-002] The APCS sub-systems shall detect missing messages

### 1.42 [APCS-DEP-REQ-003] The APCS sub-systems shall detect received corrupt messages

### 1.43 [APCS-DEP-REQ-004] If the APCS tries to overwrite the update service, THEN the APCS shall be prevented from doing so

### 1.44 [APCS-DEP-REQ-005] While de-tumbling the APCS shall disable the de-orbit function

### 1.45 [APCS-DEP-REQ-006] If the ThrusterControl is acting erroneously, THEN the APCS shall inhibit the use of thrusters